% Simulink data dictionary CHB_Data.sldd

INV120_CUURENTLOOP_KP = Simulink.Parameter(2, StorageClass="Define", DataType="single")
INV120_CUURENTLOOP_KR = Simulink.Parameter(5, StorageClass="Define", DataType="single")
INV120_VOLTAGELOOP_KI = Simulink.Parameter(0.005, StorageClass="Define", DataType="single")
INV120_VOLTAGELOOP_KP = Simulink.Parameter(0.5, StorageClass="Define", DataType="single")
INV240_VOLTAGELOOP_KI = Simulink.Parameter(0.005, StorageClass="Define", DataType="single")
INV240_VOLTAGELOOP_KP = Simulink.Parameter(0.5, StorageClass="Define", DataType="single")
PFC120_CUURENTLOOP_KP = Simulink.Parameter(30, StorageClass="Define", DataType="single")
PFC120_CUURENTLOOP_KR = Simulink.Parameter(8, StorageClass="Define", DataType="single")
PFC120_POWERLOOP_KI = Simulink.Parameter(0.0001, StorageClass="Define", DataType="single")
PFC120_POWERLOOP_KP = Simulink.Parameter(0.005, StorageClass="Define", DataType="single")
PFC240_CUURENTLOOP_KP = Simulink.Parameter(5, StorageClass="Define", DataType="single")
PFC240_CUURENTLOOP_KR = Simulink.Parameter(10, StorageClass="Define", DataType="single")
PFC240_POWERLOOP_KI = Simulink.Parameter(0.0001, StorageClass="Define", DataType="single")
PFC240_POWERLOOP_KP = Simulink.Parameter(0.005, StorageClass="Define", DataType="single")

AC_in_t = Simulink.Bus()
  Vgrid: single
  Igrid: single
  Power: single

AC_out_t = Simulink.Bus()
  Vgrid: single
  Igrid: single
  Power: single

Algorithm_t = Simulink.Bus()
  Vo_rms: single  % 输出有效值
  Io_rms: single  % 输出有效值
  Vi_rms: single  % 输入有效值
  Ii_rms: single  % 输入有效值
  Vdc: single
  duty_a: single
  duty_b: single
  Vo_freq: single
  Vi_freq: single
  A: CH_t
  B: CH_t
  pfc: Power_t
  inv: Power_t

CH_t = Simulink.Bus()
  Vo_rms: single
  Io_rms: single
  Vi_rms: single
  Ii_rms: single
  Vo_freq: single
  Vi_freq: single

CMD_t = Simulink.Bus()
  run_model: Enum: CHB_MODE

PLL_t = Simulink.Bus()
  cosin: single
  sine: single
  theta: single
  q: single
  d: single
  freq: single

Pi_t = Simulink.Bus()
  P: single
  I: single
  out: single
  limit: single[1 2]  % [max min]

Power_t = Simulink.Bus()
  P_inst: single  % 瞬时功率
  P_avg: single  % 平均功率
  P: single  % 有功功率
  S: single  % 视在功率
  Q: single  % 无功功率
  PF: single  % 功率因数

Pr_t = Simulink.Bus()
  P: single
  R: single
  out: single

Relay_t = Simulink.Bus()
  jk1: boolean  % 继电器
  jk2: boolean
  jk3: boolean
  jk4: boolean
  jk5: boolean
  jk6: boolean
  jk7: boolean
  jk8: boolean
  jk9: boolean

Sampling_t = Simulink.Bus()
  AC_in: AC_in_t
  AC_out: AC_out_t
  AC_out_A: AC_out_t
  AC_out_B: AC_out_t
  AC_in_A: AC_in_t
  AC_in_B: AC_in_t
  bat_v: single[1 4]

sogi_t = Simulink.Bus()
  alpha: single
  beta: single

Algorithm = Simulink.Signal(DataType="Bus: Algorithm_t")
CMD = Simulink.Signal(DataType="Bus: CMD_t")
PI_inv = Simulink.Signal(DataType="Bus: Pi_t")
PI_power = Simulink.Signal(DataType="Bus: Pi_t")
PLL = Simulink.Signal(DataType="Bus: PLL_t")
Pr = Simulink.Signal(DataType="Bus: Pr_t")
Real = Simulink.Signal(DataType="Bus: Real_t")
Sogi_i = Simulink.Signal(DataType="Bus: sogi_t")
Sogi_v = Simulink.Signal(DataType="Bus: sogi_t")

CHB_MODE = enum(StorageType="uint8")
  STANDBY = 0
  INV120 = 1
  INV240 = 2
  PFC120 = 3
  PFC240 = 4

Sampling = Simulink.Signal(DataType="Bus: Sampling_t")